# Grasshopper definition desk-layout-algorithm.gh (Grasshopper 1.0.4)

# ----
# Room Boundary
rectangle = Rectangle(Plane=PlaneXY(0, 0, 0), XSize=Slider(74, range=0..100), YSize=Slider(16, range=0..100), Radius=0)  # -> Rectangle, Length
crv = Curve(rectangle.Rectangle)

# ----
# Desk Width
panel = Panel("4")
# Desk Depth
panel_2 = Panel("2")
# Select Desk Geometry
crv_2 = Curve([<curve referenced from the Rhino model> x2])
explode = Explode(Curve=crv_2, Recursive=True)  # -> Segments, Vertices

explode_2 = Explode(Curve=crv, Recursive=True)  # -> Segments, Vertices
# Select Shorter Edge of the Room
len = Length(Curve=explode_2.Segments)
sort = SortList(Keys=len, ValuesA=explode_2.Segments)  # -> Keys, ValuesA
item = ListItem(List=sort.ValuesA, Index="0", Wrap=True)
crv_3 = Curve(item)

item_2 = ListItem(List=flatten(explode.Segments), Index=Slider(6, range=0..10), Wrap=True)
mirror = MirrorCurve(Geometry=crv_2, Curve=item_2, Tangent=True)
rev = ReverseList(List=sort.ValuesA)
flip = FlipCurve(Curve=crv_3)  # -> Curve, Flag

multiplication = Multiplication(A=panel_2, B="2")
# 2P Desk Cluster
division = Division(A=panel, B="2")
crv_4 = Curve([crv_2, mirror])
bbox = BoundingBox(Content=crv_4, Plane=PlaneXY(0, 0, 0), UnionBox=True)  # -> Box, Box_2
area = Area(Geometry=bbox.Box)  # -> Area, Centroid
amp = Amplitude(Vector=flip.Curve, Amplitude=division)
move = Move(Geometry=area.Centroid, Motion=amp)  # -> Geometry, Transform

item_3 = ListItem(List=rev, Index="0", Wrap=True)
crv_5 = Curve(item_3)
# Longitudinal
# vector
flip_2 = FlipCurve(Curve=crv_5)  # -> Curve, Flag

# ----
# Min. Clearance from the Last Desk to the adjacent
clearance_ft = Slider(4, range=0..10)
amp_2 = Amplitude(Vector=flip_2.Curve, Amplitude=clearance_ft)
# Edge1 of desk cluster
move_2 = Move(Geometry=crv_3, Motion=amp_2)  # -> Geometry, Transform

amp_3 = Amplitude(Vector=flip_2.Curve, Amplitude=panel_2)

# ----
# Caculate # of Rows
len_2 = Length(Curve=crv_3)
division_2 = Division(A=len_2, B=panel)
round = Round(Number=division_2)  # -> Nearest, Floor, Ceiling

amp_4 = Amplitude(Vector=crv_3, Amplitude=panel)

len_3 = Length(Curve=item_3)
multiplication_2 = Multiplication(A=clearance_ft, B="2")
subtraction = Subtraction(A=len_3, B=multiplication_2)

# ----
# Desk Back-to-Back
clearance_ft_2 = Slider(4.476, range=0..20)
# Center of cluster
move_3 = Move(Geometry=move_2.Geometry, Motion=amp_3)  # -> Geometry, Transform
addition = Addition(A=clearance_ft_2, B=multiplication)
# Vector of Cluster
# Grid Module
amp_5 = Amplitude(Vector=flip_2.Curve, Amplitude=addition)

# ----
# Edge2 of desk cluster
mirror_2 = MirrorCurve(Geometry=move_2.Geometry, Curve=move_3.Geometry, Tangent=True)

# ----
# Caculate # of Columns
addition_2 = Addition(A=subtraction, B=clearance_ft_2)
addition_3 = Addition(A=clearance_ft_2, B=multiplication)
division_3 = Division(A=addition_2, B=addition_3)
round_2 = Round(Number=division_3)  # -> Nearest, Floor, Ceiling

# ----
# Centers of cluster array
subtraction_2 = Subtraction(A=round_2.Floor, B="1")
# Edge2 of the last desk of open office
multiplication_3 = Multiplication(A=amp_5, B=subtraction_2)

arrlinear = LinearArray(Geometry=move_3.Geometry, Direction=amp_5, Count=round_2.Floor)  # -> Geometry, Transform

move_4 = Move(Geometry=mirror_2, Motion=multiplication_3)  # -> Geometry, Transform
explode_3 = Explode(Curve=arrlinear.Geometry, Recursive=True)  # -> Segments, Vertices
item_4 = ListItem(List=explode_3.Vertices, Index=0, Wrap=True)

# ----
# Option: Having a breakout area inside, if empty space >= XX
# Place Desks
orient = Orient(Geometry=crv_4, Source=move.Geometry, Target=item_4)  # -> Geometry, Transform
# Option: Desk size
# Desk - Cluster - Open Office
arrlinear_2 = LinearArray(Geometry=orient.Geometry, Direction=amp_4, Count=round.Floor)  # -> Geometry, Transform
