# Grasshopper definition grid-algorithm.gh (Grasshopper 1.0.7)

# GRID MODULE SIZE
module_size = Slider(2.78, range=0..20)
# BUILDING CORE
crv = Curve(<curve referenced from the Rhino model>)
# BUILDING PERIMETER
crv_2 = Curve(<curve referenced from the Rhino model>)
# AXIS CENTER POINT
crv_3 = Curve(<curve referenced from the Rhino model>)
area = Area(Geometry=crv_3)  # -> Area, Centroid
explode = Explode(Curve=crv, Recursive=True)  # -> Segments, Vertices
explode_2 = Explode(Curve=crv_2, Recursive=True)  # -> Segments, Vertices

# ----
# NORTH
number_slider = Slider(2, range=0..3)
item = ListItem(List=explode.Segments, Index=number_slider, Wrap=True)
item_2 = ListItem(List=explode_2.Segments, Index=number_slider, Wrap=True)
eval = EvaluateLength(Curve=item, Length="0.5", Normalized=True)  # -> Point, Tangent, Parameter
crv_cp = CurveClosestPoint(Point=eval.Point, Curve=item_2)  # -> Point, Parameter, Distance
vec2pt = Vector2Pt(PointA=eval.Point, PointB=crv_cp.Point, Unitize=False)  # -> Vector, Length
division = Division(A=crv_cp.Distance, B=module_size)
division_2 = Division(A=vec2pt.Vector, B=vec2pt.Length)
crv_cp_2 = CurveClosestPoint(Point=area.Centroid, Curve=item)  # -> Point, Parameter, Distance
round = Round(Number=division)  # -> Nearest, Floor, Ceiling
multiplication = Multiplication(A=division_2, B=module_size)
division_3 = Division(A=crv_cp_2.Distance, B=module_size)
panel = Panel(round.Floor)
round_2 = Round(Number=division_3)  # -> Nearest, Floor, Ceiling
neg = Negative(Value=multiplication)
panel_2 = Panel(round_2.Floor)
addition = Addition(A=round.Floor, B="1")
addition_2 = Addition(A=round_2.Floor, B="1")
arrlinear = LinearArray(Geometry=item, Direction=multiplication, Count=addition)  # -> Geometry, Transform
arrlinear_2 = LinearArray(Geometry=item, Direction=neg, Count=addition_2)  # -> Geometry, Transform

# ----
# SOUTH
number_slider_2 = Slider(0, range=0..3)
item_3 = ListItem(List=explode.Segments, Index=number_slider_2, Wrap=True)
item_4 = ListItem(List=explode_2.Segments, Index=number_slider_2, Wrap=True)
eval_2 = EvaluateLength(Curve=item_3, Length="0.5", Normalized=True)  # -> Point, Tangent, Parameter
crv_cp_3 = CurveClosestPoint(Point=eval_2.Point, Curve=item_4)  # -> Point, Parameter, Distance
vec2pt_2 = Vector2Pt(PointA=eval_2.Point, PointB=crv_cp_3.Point, Unitize=False)  # -> Vector, Length
division_4 = Division(A=crv_cp_3.Distance, B=module_size)
division_5 = Division(A=vec2pt_2.Vector, B=vec2pt_2.Length)
crv_cp_4 = CurveClosestPoint(Point=area.Centroid, Curve=item_3)  # -> Point, Parameter, Distance
round_3 = Round(Number=division_4)  # -> Nearest, Floor, Ceiling
multiplication_2 = Multiplication(A=division_5, B=module_size)
division_6 = Division(A=crv_cp_4.Distance, B=module_size)
panel_3 = Panel(round_3.Floor)
round_4 = Round(Number=division_6)  # -> Nearest, Floor, Ceiling
neg_2 = Negative(Value=multiplication_2)
panel_4 = Panel(round_4.Floor)
addition_3 = Addition(A=round_3.Floor, B="1")
addition_4 = Addition(A=round_4.Floor, B="1")
arrlinear_3 = LinearArray(Geometry=item_3, Direction=multiplication_2, Count=addition_3)  # -> Geometry, Transform
arrlinear_4 = LinearArray(Geometry=item_3, Direction=neg_2, Count=addition_4)  # -> Geometry, Transform

# ----
# EAST
number_slider_3 = Slider(1, range=0..3)
item_5 = ListItem(List=explode.Segments, Index=number_slider_3, Wrap=True)
item_6 = ListItem(List=explode_2.Segments, Index=number_slider_3, Wrap=True)
eval_3 = EvaluateLength(Curve=item_5, Length="0.5", Normalized=True)  # -> Point, Tangent, Parameter
crv_cp_5 = CurveClosestPoint(Point=eval_3.Point, Curve=item_6)  # -> Point, Parameter, Distance
vec2pt_3 = Vector2Pt(PointA=eval_3.Point, PointB=crv_cp_5.Point, Unitize=False)  # -> Vector, Length
division_7 = Division(A=crv_cp_5.Distance, B=module_size)
division_8 = Division(A=vec2pt_3.Vector, B=vec2pt_3.Length)
crv_cp_6 = CurveClosestPoint(Point=area.Centroid, Curve=item_5)  # -> Point, Parameter, Distance
round_5 = Round(Number=division_7)  # -> Nearest, Floor, Ceiling
multiplication_3 = Multiplication(A=division_8, B=module_size)
division_9 = Division(A=crv_cp_6.Distance, B=module_size)
panel_5 = Panel(round_5.Floor)
round_6 = Round(Number=division_9)  # -> Nearest, Floor, Ceiling
neg_3 = Negative(Value=multiplication_3)
panel_6 = Panel(round_6.Floor)
addition_5 = Addition(A=round_5.Floor, B="1")
addition_6 = Addition(A=round_6.Floor, B="1")
arrlinear_5 = LinearArray(Geometry=item_5, Direction=multiplication_3, Count=addition_5)  # -> Geometry, Transform
arrlinear_6 = LinearArray(Geometry=item_5, Direction=neg_3, Count=addition_6)  # -> Geometry, Transform

# ----
# WEST
number_slider_4 = Slider(3, range=0..3)
item_7 = ListItem(List=explode.Segments, Index=number_slider_4, Wrap=True)
item_8 = ListItem(List=explode_2.Segments, Index=number_slider_4, Wrap=True)
eval_4 = EvaluateLength(Curve=item_7, Length="0.5", Normalized=True)  # -> Point, Tangent, Parameter
crv_cp_7 = CurveClosestPoint(Point=eval_4.Point, Curve=item_8)  # -> Point, Parameter, Distance
vec2pt_4 = Vector2Pt(PointA=eval_4.Point, PointB=crv_cp_7.Point, Unitize=False)  # -> Vector, Length
division_10 = Division(A=crv_cp_7.Distance, B=module_size)
division_11 = Division(A=vec2pt_4.Vector, B=vec2pt_4.Length)
crv_cp_8 = CurveClosestPoint(Point=area.Centroid, Curve=item_7)  # -> Point, Parameter, Distance
round_7 = Round(Number=division_10)  # -> Nearest, Floor, Ceiling
multiplication_4 = Multiplication(A=division_11, B=module_size)
division_12 = Division(A=crv_cp_8.Distance, B=module_size)
panel_7 = Panel(round_7.Floor)
round_8 = Round(Number=division_12)  # -> Nearest, Floor, Ceiling
neg_4 = Negative(Value=multiplication_4)
panel_8 = Panel(round_8.Floor)
addition_7 = Addition(A=round_7.Floor, B="1")
addition_8 = Addition(A=round_8.Floor, B="1")
arrlinear_7 = LinearArray(Geometry=item_7, Direction=multiplication_4, Count=addition_7)  # -> Geometry, Transform
arrlinear_8 = LinearArray(Geometry=item_7, Direction=neg_4, Count=addition_8)  # -> Geometry, Transform

# ----
# AXIS
crv_cp_9 = CurveClosestPoint(Point=area.Centroid, Curve=item_4)  # -> Point, Parameter, Distance
crv_cp_10 = CurveClosestPoint(Point=area.Centroid, Curve=item_6)  # -> Point, Parameter, Distance
# East-West
orient = Orient(Geometry=item_4, Source=crv_cp_9.Point, Target=area.Centroid)  # -> Geometry, Transform
# North-South
orient_2 = Orient(Geometry=item_6, Source=crv_cp_10.Point, Target=area.Centroid)  # -> Geometry, Transform

len = Length(Curve=explode_2.Segments)
sort = SortList(Keys=len)  # -> Keys, ValuesA
rev = ReverseList(List=sort.Keys)
item_9 = ListItem(List=rev, Index="0", Wrap=True)
crv_4 = Curve([orient.Geometry, orient_2.Geometry])
crv_5 = Curve([arrlinear_4.Geometry, arrlinear_3.Geometry, arrlinear.Geometry, arrlinear_2.Geometry, arrlinear_5.Geometry, arrlinear_6.Geometry, arrlinear_7.Geometry, arrlinear_8.Geometry])
ext = ExtendCurve(Curve=crv_5, Type=0, Start=item_9, End=item_9)  # -> flatten(Curve)
boundary = BoundarySurfaces(Edges=crv_2)
xy = XYPlane(Origin=Point(0, 0, 0))
trim = TrimWithRegion(Curve=ext, Region=boundary, Plane=xy)  # -> Inside, Outside
crv_6 = Curve(trim.Inside)
preview = CustomPreview(Geometry=crv_6, Material=ColourSwatch(SwatchColor=RGB(189, 189, 189)))
preview_2 = CustomPreview(Geometry=crv_4, Material=ColourSwatch(SwatchColor=RGB(255, 0, 0)))
